# Grasshopper definition customsprite 001.gh (Grasshopper 0.9.6)
# plug-ins: CustomSprite, Wallaby

crv = Curve(<curve referenced from the Rhino model>)
divide = DivideCurve(Curve=crv, Count=6, Kinks=False)  # -> Points, Tangents, Parameters
pt = Point([<point referenced from the Rhino model> x6])
pcharge = PointCharge(Point=pt, Charge=[-1, 1, -1, 1, -1, 1], Decay=1)
mergef = MergeFields(Fields=pcharge)
ptemitter = PtEmitter(
    Point=divide.Points,
    Field=mergef,
    Charge=1,
    Particles=25,
    InitialVelocity=expr("vi*0.1", divide.Tangents),
    Randomness=Slider(0.76, range=0..1),
    Seed=0,
    Elasticity=1,
    Ground=True,
    Iteration=Slider(125, range=0..500),
    Solver=0)  # -> Trajectories, Location, Vector
flip = FlipMatrix(Data=ptemitter.Location)
flip_2 = FlipMatrix(Data=ptemitter.Vector)
lng = ListLength(List=flip)
lng_2 = ListLength(List=flip_2)
item = ListItem(List=flip, Index=expr("i-1", lng), Wrap=False)
item_2 = ListItem(List=flip_2, Index=expr("i-1", lng_2), Wrap=False)
pt_2 = Point(item)
vlen = VectorLength(Vector=item_2)
panel = Panel(vlen)
larger = LargerThan(FirstNumber=vlen, SecondNumber=Slider(0.04, range=0..1))  # -> LargerThan, OrEqualTo
not = GateNot(A=larger.LargerThan)
cull = CullPattern(List=pt_2, CullPattern=larger.OrEqualTo)
cull_2 = CullPattern(List=pt_2, CullPattern=not)
panel_2 = Panel("E:\grasshopper64.png")
customsprite = CustomSprite(
    Sprite="E:\turtle64.png",
    Color=ColourSwatch(SwatchColor=RGB(255, 255, 255)),
    Location=flatten(cull_2),
    Size=Slider(0.396, range=0..1))
