# Grasshopper definition customsprite 002.gh (Grasshopper 0.9.6)
# plug-ins: Wallaby

pt = Point(<point referenced from the Rhino model>)
pt_2 = Point([<point referenced from the Rhino model> x3])
lng = ListLength(List=pt_2)
random = Random(Range=Domain(0, 1000), Number=lng, Seed=2, Integers=True)
pcharge = PointCharge(Point=pt, Charge=-20, Decay=1)
ptemitter = PtEmitter(
    Point=pt_2,
    Field=pcharge,
    Charge=1,
    Particles=Slider(5, range=1..10),
    InitialVelocity=Vector(0, 0, 1),
    Randomness=Slider(0.69, range=0..1),
    Seed=random,
    Elasticity=0.1,
    Ground=False,
    Iteration=Slider(215, range=0..500),
    Solver=0)  # -> Trajectories, Location, Vector
slider = Slider(0.25, range=0..1)
pt_3 = Point(ptemitter.Location)
panel = Panel("E:\Fondos\grasshopper64.png")
swatch = ColourSwatch(SwatchColor=RGB(255, 255, 255))
