# Grasshopper definition customsprite 003.gh (Grasshopper 0.9.6)
# plug-ins: CustomSprite, Wallaby

pt = Point(<point referenced from the Rhino model>)
pt_2 = Point([<point referenced from the Rhino model> x3])
lng = ListLength(List=pt_2)
random = Random(Range=Domain(0, 1000), Number=lng, Seed=4, Integers=True)
pcharge = PointCharge(Point=pt, Charge=-20, Decay=1)
ptemitter = PtEmitter(
    Point=pt_2,
    Field=pcharge,
    Charge=1,
    Particles=Slider(1, range=1..10),
    InitialVelocity=expr("Vi*0.7", Vector(0, 0, 1)),
    Randomness=Slider(0.768, range=0..1),
    Seed=random,
    Elasticity=0.1,
    Ground=False,
    Iteration=Slider(114, range=0..300),
    Solver=0)  # -> Trajectories, Location, Vector
flip = FlipMatrix(Data=ptemitter.Location)
flip_2 = FlipMatrix(Data=ptemitter.Vector)
pt_3 = Point(ptemitter.Location)
viewer = ParamViewer(ptemitter.Location)
customsprite = CustomSprite(
    Sprite="E:\Fondos\corn64.png",
    Color=ColourSwatch(SwatchColor=RGB(255, 255, 255)),
    Location=pt,
    Size=Slider(1, range=0..1))
lng_2 = ListLength(List=flip)  # disabled
lng_3 = ListLength(List=flip_2)  # disabled
flip_3 = FlipMatrix(Data=pt_3)
item = ListItem(List=flip, Index=expr("i-1", lng_2), Wrap=False)  # disabled
item_2 = ListItem(List=flip_2, Index=expr("i-1", lng_3), Wrap=False)  # disabled
intcrv = Interpolate(Vertices=flip_3, Degree=3, Periodic=False, KnotStyle=1)  # -> Curve, Length, Domain
customsprite_2 = CustomSprite(
    Sprite="E:\Fondos\grasshopper64.png",
    Color=ColourSwatch(SwatchColor=RGB(255, 255, 255)),
    Location=pt_3,
    Size=Slider(0.284, range=0..1))
